# Grasshopper definition SDK_Footfall_Analysis_230613.gh (Grasshopper 1.0.7)
# plug-ins: StructuralDesignKitGH, Parametric_FEM_Toolbox

get_data = GetData(RunComponent=Button(), Lines=Toggle(True))  # -> RFNodes, RFLines, RFMembers, RFSurfaces, RFOpenings, RFNodalSupports, RFLineSupports, RFSurfaceSupports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
rfline = RFLine(RFLine=get_data.RFLines, mode="Disassemble")  # -> Line, LineNumber, Comment, NodeList, LineType, RotationAngle_, RotationType
crv = Curve(rfline.Line)

target = Point(<point referenced from the Rhino model>)
number_slider = Slider(2, range=1.7..2.7)
# Project: Vibration Setup
# Author: Guillaume Caussarieu
# Date:13.06.2023
button = Button()
radgrid = Radial(Plane=target, Size=Slider(0.5, range=0..20), ExtentR=Slider(8, range=5..10), ExtentP=Slider(30, range=10..30))  # -> Cells, Points
vibrationdata = GetRFEMVibrationData(Run=button)
intcrv = Interpolate(Vertices=radgrid.Points, Degree=3, Periodic=True, KnotStyle=1)  # -> Curve, Length, Domain
pt = Point(flatten(radgrid.Points))
# Resonant  Response 2 points
resonantresponse_2_points = VibrationResonantResponse2Points(
    Data=vibrationdata,
    PaceFrequency=number_slider,
    DampingRatio="0.035",
    WeigthingCategory="CirculationSpace",
    ResponseFactor="true",
    WalkingLength="-1",
    ExcitationPoint=target,
    ResponsePoints=pt)  # -> Points, Response
# Resonant  Response
resonantresponse = VibrationResonantResponse(
    Data=vibrationdata,
    PaceFrequency=number_slider,
    DampingRatio="0.035",
    WeigthingCategory="CirculationSpace",
    ResponseFactor="true",
    WalkingLength="-1")  # -> Points, Response
sphere_size = Slider(0.0068, range=0..1)
panel = Panel("{0:0}")  # disabled
multiplication = Multiplication(A=resonantresponse.Response, B=sphere_size)
format = Format(Format=panel, Culture=127, Data0=resonantresponse_2_points.Response)
format_2 = Format(Format="{0:0}", Culture=127, Data0=resonantresponse.Response)
msphere = MeshSphere(Base=resonantresponse.Points, Radius=multiplication, UCount=10, VCount=20)
threshold = Slider(12, range=1..20)
tag = TextTag3D(
    Location=resonantresponse_2_points.Points,
    Text=format,
    Size=Slider(0.189, range=0..1),
    Colour=RGB(4, 0, 255),
    Justification=7)
tag_2 = TextTag3D(Location=resonantresponse.Points, Text=format_2, Size=Slider(0.101, range=0..1), Colour=RGB(4, 0, 255), Justification=7)
larger = LargerThan(FirstNumber=resonantresponse.Response, SecondNumber=threshold)  # -> LargerThan, OrEqualTo
dispatch = Dispatch(List=msphere, DispatchPattern=larger.LargerThan)  # -> ListA, ListB
mcol = MeshColours(Mesh=dispatch.ListA, Colours=ColourSwatch(SwatchColor=RGBA(255, 0, 0, 200)))
mcol_2 = MeshColours(Mesh=dispatch.ListB, Colours=ColourSwatch(SwatchColor=RGBA(0, 0, 255, 200)))
merge = Merge(Data1=mcol, Data2=mcol_2)
